# Grasshopper definition Data Prep_TU Delft.gh (Grasshopper 1.0.7)
# plug-ins: TT Toolbox

area = Area(Geometry=<curve referenced from the Rhino model>)  # -> Area, Centroid
multiplication = Multiplication(A=area.Area, B=Slider(900, range=0..1000))
panel = Panel(multiplication)

panel_2 = Panel("\"D:\\TU DELFT - Master Thesis\\UF-DecisionMaker\\coordinates.txt\"")
file_path = FilePath(panel_2)
ghpython_script = GhPythonScript(coordinates_file=file_path)  # -> out, graft(start_x), graft(start_y), graft(end_x), graft(end_y)
# ---------- ghpython_script: Python ----------
__author__ = "ereng"
__version__ = "2022.04.18"

import rhinoscriptsyntax as rs

from ghpythonlib import treehelpers as th
import json

def to_raw(string):
    string = string.replace("\"", "")
    return r"{}".format(string)

coordinates_file = to_raw(coordinates_file)

print("Occupied nodes path: " + coordinates_file)

#reading exported Nodes JSON file
with open(str(coordinates_file)) as json_file_nodes:
    coordinates = json.load(json_file_nodes)
print(coordinates)

start1=[]
start2=[]
end1=[]
end2=[]
for item in coordinates:
    s1=item[0][0]
    s2=item[0][1]
    e1=item[1][0]
    e2=item[1][1]
    start1.append(s1)
    start2.append(s2)
    end1.append(e1)
    end2.append(e2)
start_x=start1
start_y=start2
end_x=end1
end_y=end2
# ---------- end ghpython_script ----------
construct_point = ConstructPoint(XCoordinate=ghpython_script.start_x, YCoordinate=ghpython_script.start_y, ZCoordinate=0)
construct_point_2 = ConstructPoint(XCoordinate=ghpython_script.end_x, YCoordinate=ghpython_script.end_y, ZCoordinate=0)
point = Point(construct_point_2)
point_2 = Point(construct_point)
line = Line(StartPoint=point_2, EndPoint=point)
polygon = Polygon(Plane=point, Radius=1, Segments=3, FilletRadius=0)  # -> Polygon, Length
circle = Circle(Plane=point_2, Radius=0.5)
surface = Surface(circle)

panel_3 = Panel("\"D:\\TU DELFT - Master Thesis\\UF-DecisionMaker\\new_edges.txt\"")
ghpython_script_2 = GhPythonScript()  # -> out, start_waste, flatten(check); inputs waste_list: list, vacant_list: list
# ---------- ghpython_script_2: Python ----------
__author__ = "ereng"
__version__ = "2022.04.18"

import rhinoscriptsyntax as rs


coordinates=[]
check=[]
print("waste",waste_list[0])
print("start",start)

if start == waste_list[0]:
    start_waste=waste_list[0],waste_list[1]
# ---------- end ghpython_script_2 ----------
file_path_2 = FilePath(panel_3)
ghpython_script_3 = GhPythonScript(edge_list=file_path_2)  # -> out, start, end, source; inputs y: list
# ---------- ghpython_script_3: Python ----------
__author__ = "ereng"
__version__ = "2022.04.18"

import rhinoscriptsyntax as rs

from ghpythonlib import treehelpers as th
import json

def to_raw(string):
    string = string.replace("\"", "")
    return r"{}".format(string)

edge_list = to_raw(edge_list)

print("Occupied nodes path: " + edge_list)

#reading exported Nodes JSON file
with open(str(edge_list)) as json_file_nodes:
    edges = json.load(json_file_nodes)

start_list=[]
end_list=[]
for item in edges:
    start_list.append(item[0])
    end_list.append(item[1])

start=start_list
end=end_list


#print(source_list)
# ---------- end ghpython_script_3 ----------
panel_4 = Panel(ghpython_script_3.end)
panel_5 = Panel(ghpython_script_3.start)
ghpython_script_4 = GhPythonScript(start=ghpython_script_3.start, end=ghpython_script_3.end)  # -> out, tuple
# ---------- ghpython_script_4: Python ----------
__author__ = "ereng"
__version__ = "2022.04.18"

import rhinoscriptsyntax as rs

tuple=start,end
# ---------- end ghpython_script_4 ----------
panel_6 = Panel(ghpython_script_4.tuple)
start_nodes = ListItem(List=ghpython_script_4.tuple, Index=0, Wrap=True)
end_nodes = ListItem(List=ghpython_script_4.tuple, Index=0, Wrap=True)

list_item = ListItem(List=panel, Index=0, Wrap=True)  # -> Item, Item1, Item2, Item3
addition = Addition(A=list_item.Item, B=list_item.Item1, C=list_item.Item2, D=list_item.Item3)
panel_7 = Panel(addition)

ghpython_script_5 = GhPythonScript()  # -> out, a
# ---------- ghpython_script_5: Python ----------
__author__ = "ereng"
__version__ = "2022.04.19"

import rhinoscriptsyntax as rs

a=x,y
print(x)
# ---------- end ghpython_script_5 ----------
panel_8 = Panel(ghpython_script_5.a)
ghpython_script_6 = GhPythonScript(x=panel_8, run=Toggle(False))  # -> out, a; inputs x: tree, run: Boolean
# ---------- ghpython_script_6: Python ----------
__author__ = "ereng"
__version__ = "2022.04.17"

fpath_edges="D:\TU DELFT - Master Thesis\UF-DecisionMaker\Edges_vacant100.txt"
import rhinoscriptsyntax as rs
import ghpythonlib.treehelpers as th
import json

edge_list1=th.tree_to_list(x)

edge_list=[]
for item in edge_list1:
    print(item)
    item=tuple(item)
    print(item)
    list.append(edge_list,item)
edge_list=tuple(edge_list)
print(edge_list)    
    
if run:
    with open(str(fpath_edges), 'w') as outfile:
            json.dump(edge_list, outfile)
# ---------- end ghpython_script_6 ----------

panel_9 = Panel()
panel_10 = Panel()
ghpython_script_7 = GhPythonScript(x=panel_10, y=panel_9)  # -> out, a
# ---------- ghpython_script_7: Python ----------
__author__ = "ereng"
__version__ = "2022.04.19"

import rhinoscriptsyntax as rs

a=x,y
# ---------- end ghpython_script_7 ----------
panel_11 = Panel(ghpython_script_7.a)
ghpython_script_8 = GhPythonScript(x=panel_11, run=Toggle(False))  # -> out, a; inputs x: tree, run: Boolean
# ---------- ghpython_script_8: Python ----------
__author__ = "ereng"
__version__ = "2022.04.17"

fpath_edges="D:\TU DELFT - Master Thesis\UF-DecisionMaker\Edges1.txt"

import rhinoscriptsyntax as rs
import ghpythonlib.treehelpers as th
import json

edge_list1=th.tree_to_list(x)

edge_list=[]
for item in edge_list1:
    print(item)
    item=tuple(item)
    print(item)
    list.append(edge_list,item)
edge_list=tuple(edge_list)
print(len(edge_list))
    
if run:
    with open(str(fpath_edges), 'w') as outfile:
            json.dump(edge_list, outfile)
    a=edge_list
# ---------- end ghpython_script_8 ----------
panel_12 = Panel(ghpython_script_8.a)

number_slider = Slider(0.5, range=0..1)

curve_middle = CurveMiddle(Curve=line)
unit_z = UnitZ(Factor=Slider(0, range=0..50))
move = Move(Geometry=curve_middle, Motion=unit_z)  # -> Geometry, Transform
merge = Merge(Data1=point_2, Data2=move.Geometry, Data3=point)
panel_13 = Panel(merge)
polyline = PolyLine(Vertices=merge, Closed=False)
interpolate = Interpolate(Vertices=panel_13, Degree=3, Periodic=False, KnotStyle=1)  # -> Curve, Length, Domain
curve = Curve(polyline)
sphere = Sphere(Base=point_2, Radius=1)
pipe = Pipe(Curve=interpolate.Curve, Radius=0.25, Caps=1)
center_box = CenterBox(Base=point, X=number_slider, Y=number_slider, Z=number_slider)
custom_preview = CustomPreview(Geometry=[center_box, sphere, pipe], Material=ColourSwatch(SwatchColor=RGB(255, 255, 75)))

area_2 = Area(Geometry=[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])  # -> Area, Centroid
waste = Point(area_2.Centroid)
deconstruct = Deconstruct(Point=waste)  # -> XComponent, YComponent, ZComponent
construct_point_3 = ConstructPoint(XCoordinate=deconstruct.XComponent, YCoordinate=deconstruct.YComponent, ZCoordinate=deconstruct.ZComponent)
create_set = CreateSet(List=construct_point_3)  # -> Set, Map
panel_14 = Panel(create_set.Map)
coordınate = Point(create_set.Set)
panel_15 = Panel(coordınate)
ghpython_script_9 = GhPythonScript(x=panel_14, y="WO", coordinates=panel_15)  # -> out, graft(identifier), graft(b)
# ---------- ghpython_script_9: Python ----------
__author__ = "ereng"
__version__ = "2022.04.15"

import rhinoscriptsyntax as rs

identifier = y+str(x)
b= coordinates
# ---------- end ghpython_script_9 ----------
panel_16 = Panel(ghpython_script_9.b)
panel_17 = Panel(ghpython_script_9.identifier)
text_tag = TextTag(Location=ghpython_script_9.b, Text=panel_17, Colour=RGB(245, 117, 106))

# ---- group: Recognise Vacant Spaces & Give Identifiers
vacant_space = Curve([<curve referenced from the Rhino model> x146])
area_3 = Area(Geometry=vacant_space)  # -> Area, Centroid
sort_areas_of_spaces = SortList(Keys=area_3.Area, ValuesValuesA=area_3.Centroid)  # -> reverse(Keys), reverse(ValuesValuesA)
deconstruct_2 = Deconstruct(Point=sort_areas_of_spaces.ValuesValuesA)  # -> XComponent, YComponent, ZComponent
construct_point_4 = ConstructPoint(XCoordinate=deconstruct_2.XComponent, YCoordinate=deconstruct_2.YComponent, ZCoordinate=deconstruct_2.ZComponent)
point_3 = Point(construct_point_4)
create_set_2 = CreateSet(List=point_3)  # -> Set, Map
point_4 = Point(graft(point_3))
v_index = GhPythonScript(x=create_set_2.Map, y="V")  # -> out, graft(a)
# ---------- v_index: Python ----------
__author__ = "ereng"
__version__ = "2022.04.15"

import rhinoscriptsyntax as rs

a = y+str(x)
# ---------- end v_index ----------
panel_18 = Panel(v_index.a)
label_node_on_map = TextTag(Location=point_4, Text=panel_18, Colour=RGB(181, 0, 0))

# ----
# 1. Assign Identifiers (V0 or WO0)
# 0. Input Vacant Spaces
# 0. Input Waste Sources
panel_19 = Panel(create_set_2.Map)

# ----
# 2. Store Coordinates & Identifiers Together
merge_2 = Merge(Data1=v_index.a, Data2=point_4, Data3=graft(sort_areas_of_spaces.Keys))  # -> simplify(Result)
panel_20 = Panel(merge_2)
param_viewer = ParamViewer(merge_2)
list_item_2 = ListItem(List=merge_2, Index=Slider(1, range=0..1), Wrap=True)
vacant_spaces = Point(list_item_2)

merge_3 = Merge(Data1=ghpython_script_9.identifier, Data2=ghpython_script_9.b)  # -> simplify(Result)
panel_21 = Panel(merge_3)
param_viewer_2 = ParamViewer(merge_3)
list_item_3 = ListItem(List=merge_3, Index=Slider(1, range=0..1), Wrap=True)
waste_outputs = Point(flatten(list_item_3))

# ----
# Draw Lines Between Vacant Spaces
vacant_spaces_around = Point(flatten(vacant_spaces))
vacant_space_2 = Point(vacant_spaces)
line_2 = Line(StartPoint=vacant_space_2, EndPoint=vacant_spaces_around)
clean_tree = CleanTree(RemoveNulls=True, RemoveInvalid=True, RemoveEmpty=False, Tree=line_2)  # -> simplify(Tree)
length = Length(Curve=clean_tree)
line_3 = Line(clean_tree)
number_slider_2 = Slider(100, range=0..100)
sort_lengths = SortList(Keys=length, ValuesValuesA=line_3)  # -> Keys, ValuesValuesA
circle_2 = Circle(Plane=vacant_spaces, Radius=number_slider_2)
within_search_radius = GhPythonScript(x=sort_lengths.Keys, y=number_slider_2, line=sort_lengths.ValuesValuesA)  # -> out, a
# ---------- within_search_radius: Python ----------
__author__ = "ereng"
__version__ = "2022.03.18"

import rhinoscriptsyntax as rs
import GhPython as gh

if x<y:
    a = line
else:
    pass
# ---------- end within_search_radius ----------
line_4 = Line(within_search_radius.a)
clean_tree_2 = CleanTree(RemoveNulls=True, RemoveInvalid=True, RemoveEmpty=False, Tree=line_4)
end_points = EndPoints(Curve=clean_tree_2)  # -> flatten(Start), flatten(End)

# ----
# Draw Lines Between Vacant Spaces
vacant_spaces_around_2 = Point(flatten(vacant_spaces))
vacant_space_3 = Point(vacant_spaces)
line_5 = Line(StartPoint=vacant_space_3, EndPoint=vacant_spaces_around_2)
# 4. Vacant Spaces Within 100 meters
clean_tree_3 = CleanTree(RemoveNulls=True, RemoveInvalid=True, RemoveEmpty=False, Tree=line_5)  # -> simplify(Tree)
length_2 = Length(Curve=clean_tree_3)
line_6 = Line(clean_tree_3)
number_slider_3 = Slider(500, range=0..500)
sort_lengths_2 = SortList(Keys=length_2, ValuesValuesA=line_6)  # -> Keys, ValuesValuesA
circle_3 = Circle(Plane=vacant_spaces, Radius=number_slider_3)
within_search_radius_2 = GhPythonScript(x=sort_lengths_2.Keys, y=number_slider_3, line=sort_lengths_2.ValuesValuesA)  # -> out, a; same code as within_search_radius
line_7 = Line(within_search_radius_2.a)
clean_tree_4 = CleanTree(RemoveNulls=True, RemoveInvalid=True, RemoveEmpty=False, Tree=line_7)
end_points_2 = EndPoints(Curve=clean_tree_4)  # -> flatten(Start), flatten(End)

# ----
# Draw Lines Between Vacant Spaces
vacant_spaces_around_3 = Point(flatten(vacant_spaces))
vacant_space_4 = Point(vacant_spaces)
line_8 = Line(StartPoint=vacant_space_4, EndPoint=vacant_spaces_around_3)
# 4. Vacant Spaces Within 100 meters
clean_tree_5 = CleanTree(RemoveNulls=True, RemoveInvalid=True, RemoveEmpty=False, Tree=line_8)  # -> simplify(Tree)
length_3 = Length(Curve=clean_tree_5)
line_9 = Line(clean_tree_5)
number_slider_4 = Slider(200, range=0..500)
sort_lengths_3 = SortList(Keys=length_3, ValuesValuesA=line_9)  # -> Keys, ValuesValuesA
circle_4 = Circle(Plane=vacant_spaces, Radius=number_slider_4)
within_search_radius_3 = GhPythonScript(x=sort_lengths_3.Keys, y=number_slider_4, line=sort_lengths_3.ValuesValuesA)  # -> out, a; same code as within_search_radius
line_10 = Line(within_search_radius_3.a)
clean_tree_6 = CleanTree(RemoveNulls=True, RemoveInvalid=True, RemoveEmpty=False, Tree=line_10)
end_points_3 = EndPoints(Curve=clean_tree_6)  # -> flatten(Start), flatten(End)

# ----
# Draw Lines Between
# Vacant Spaces & Waste Sources
line_11 = Line(StartPoint=vacant_spaces, EndPoint=waste_outputs)
# 3. Waste Sources Within 100 meters
length_4 = Length(Curve=line_11)
delete_consecutive = DeleteConsecutive(Set=length_4, Wrap=False)  # -> Set, Count
sort_lengths_4 = SortList(Keys=delete_consecutive.Set, ValuesValuesA=line_11)  # -> Keys, ValuesValuesA
search_radius = Slider(100, range=0..500)
smaller_than = SmallerThan(FirstNumber=sort_lengths_4.Keys, SecondNumber=search_radius)  # -> SmallerThan, OrEqualTo
circle_5 = Circle(Plane=vacant_spaces, Radius=search_radius)
cull_pattern = CullPattern(List=sort_lengths_4.ValuesValuesA, CullPattern=smaller_than.SmallerThan)  # -> flatten(List)
clean_tree_7 = CleanTree(RemoveNulls=True, RemoveInvalid=True, RemoveEmpty=False, Tree=cull_pattern)
end_points_4 = EndPoints(Curve=clean_tree_7)  # -> flatten(Start), flatten(End)

# ----
# Draw Lines Between
# Vacant Spaces & Waste Sources
line_12 = Line(StartPoint=vacant_spaces, EndPoint=waste_outputs)
# 3. Waste Sources Within 500 meters
length_5 = Length(Curve=line_12)
delete_consecutive_2 = DeleteConsecutive(Set=length_5, Wrap=False)  # -> Set, Count
sort_lengths_5 = SortList(Keys=delete_consecutive_2.Set, ValuesValuesA=line_12)  # -> Keys, ValuesValuesA
search_radius_2 = Slider(500, range=0..500)
smaller_than_2 = SmallerThan(FirstNumber=sort_lengths_5.Keys, SecondNumber=search_radius_2)  # -> SmallerThan, OrEqualTo
circle_6 = Circle(Plane=vacant_spaces, Radius=search_radius_2)
cull_pattern_2 = CullPattern(List=sort_lengths_5.ValuesValuesA, CullPattern=smaller_than_2.SmallerThan)  # -> flatten(List)
clean_tree_8 = CleanTree(RemoveNulls=True, RemoveInvalid=True, RemoveEmpty=False, Tree=cull_pattern_2)
end_points_5 = EndPoints(Curve=clean_tree_8)  # -> flatten(Start), flatten(End)

# ----
# Draw Lines Between
# Vacant Spaces & Waste Sources
line_13 = Line(StartPoint=vacant_spaces, EndPoint=waste_outputs)
# 3. Waste Sources Within 200 meters
length_6 = Length(Curve=line_13)
delete_consecutive_3 = DeleteConsecutive(Set=length_6, Wrap=False)  # -> Set, Count
sort_lengths_6 = SortList(Keys=delete_consecutive_3.Set, ValuesValuesA=line_13)  # -> Keys, ValuesValuesA
search_radius_3 = Slider(200, range=0..500)
smaller_than_3 = SmallerThan(FirstNumber=sort_lengths_6.Keys, SecondNumber=search_radius_3)  # -> SmallerThan, OrEqualTo
circle_7 = Circle(Plane=vacant_spaces, Radius=search_radius_3)
cull_pattern_3 = CullPattern(List=sort_lengths_6.ValuesValuesA, CullPattern=smaller_than_3.SmallerThan)  # -> flatten(List)
clean_tree_9 = CleanTree(RemoveNulls=True, RemoveInvalid=True, RemoveEmpty=False, Tree=cull_pattern_3)
end_points_6 = EndPoints(Curve=clean_tree_9)  # -> flatten(Start), flatten(End)

# ----
# Activate To Export Pairs
# 4. Vacant Spaces Within 100 meters
boolean_toggle = BooleanToggle(False)

# ----
# Coordinate Pairs
# (Vacant Space, Waste)
panel_22 = Panel(end_points_4.End)
panel_23 = Panel(end_points_4.Start)
ghpython_script_10 = GhPythonScript(x=panel_23, y=panel_22)  # -> out, a; same code as ghpython_script_7
panel_24 = Panel(ghpython_script_10.a)

# ----
# Coordinate Pairs
# (Vacant Space, Waste)
panel_25 = Panel(end_points_5.End)
panel_26 = Panel(end_points_5.Start)
ghpython_script_11 = GhPythonScript(x=panel_26, y=panel_25)  # -> out, a; same code as ghpython_script_7
panel_27 = Panel(ghpython_script_11.a)

# ----
# Coordinate Pairs
# (Vacant Space, Waste)
panel_28 = Panel(end_points_6.End)
panel_29 = Panel(end_points_6.Start)
ghpython_script_12 = GhPythonScript(x=panel_29, y=panel_28)  # -> out, a; same code as ghpython_script_7
panel_30 = Panel(ghpython_script_12.a)

# ----
# Relate Coordinates To Identifiers
panel_31 = Panel(merge_2)
list_item_4 = ListItem(List=panel_31, Index=1, Wrap=True)  # -> flatten(Item)
find_similar_member = FindSimilarMember(Data=end_points.End, Set=list_item_4)  # -> Hit, Index
find_similar_member_2 = FindSimilarMember(Data=end_points.Start, Set=list_item_4)  # -> Hit, Index
panel_32 = Panel(find_similar_member.Hit)
v_index_2 = GhPythonScript(x=find_similar_member.Index, y="V")  # -> out, graft(a); same code as v_index
panel_33 = Panel(find_similar_member.Index)
panel_34 = Panel(find_similar_member_2.Hit)
v_index_3 = GhPythonScript(x=find_similar_member_2.Index, y="V")  # -> out, graft(a); same code as v_index
panel_35 = Panel(find_similar_member_2.Index)
panel_36 = Panel(v_index_3.a)
panel_37 = Panel(v_index_2.a)

# ----
# Relate Coordinates To Identifiers
panel_38 = Panel(merge_2)
list_item_5 = ListItem(List=panel_38, Index=1, Wrap=True)  # -> flatten(Item)
find_similar_member_3 = FindSimilarMember(Data=end_points_2.End, Set=list_item_5)  # -> Hit, Index
find_similar_member_4 = FindSimilarMember(Data=end_points_2.Start, Set=list_item_5)  # -> Hit, Index
panel_39 = Panel(find_similar_member_3.Hit)
v_index_4 = GhPythonScript(x=find_similar_member_3.Index, y="V")  # -> out, graft(a); same code as v_index
panel_40 = Panel(find_similar_member_3.Index)
panel_41 = Panel(find_similar_member_4.Hit)
v_index_5 = GhPythonScript(x=find_similar_member_4.Index, y="V")  # -> out, graft(a); same code as v_index
panel_42 = Panel(find_similar_member_4.Index)
panel_43 = Panel(v_index_5.a)
panel_44 = Panel(v_index_4.a)

# ----
# Relate Coordinates To Identifiers
panel_45 = Panel(merge_2)
list_item_6 = ListItem(List=panel_45, Index=1, Wrap=True)  # -> flatten(Item)
find_similar_member_5 = FindSimilarMember(Data=end_points_3.End, Set=list_item_6)  # -> Hit, Index
find_similar_member_6 = FindSimilarMember(Data=end_points_3.Start, Set=list_item_6)  # -> Hit, Index
v_index_6 = GhPythonScript(x=find_similar_member_5.Index, y="V")  # -> out, graft(a); same code as v_index
panel_46 = Panel(find_similar_member_5.Hit)
panel_47 = Panel(find_similar_member_5.Index)
v_index_7 = GhPythonScript(x=find_similar_member_6.Index, y="V")  # -> out, graft(a); same code as v_index
panel_48 = Panel(find_similar_member_6.Hit)
panel_49 = Panel(find_similar_member_6.Index)
panel_50 = Panel(v_index_7.a)
panel_51 = Panel(v_index_6.a)

# ----
# Relate Coordinates To Identifiers
panel_52 = Panel(merge_2)
panel_53 = Panel(merge_3)
list_item_7 = ListItem(List=panel_53, Index=1, Wrap=True)  # -> flatten(Item)
list_item_8 = ListItem(List=panel_52, Index=1, Wrap=True)  # -> flatten(Item)
find_similar_member_7 = FindSimilarMember(Data=panel_22, Set=list_item_7)  # -> Hit, Index
find_similar_member_8 = FindSimilarMember(Data=panel_23, Set=list_item_8)  # -> Hit, Index
panel_54 = Panel(find_similar_member_7.Hit)
panel_55 = Panel(find_similar_member_7.Index)
wo_index = GhPythonScript(x=find_similar_member_7.Index, y="WO")  # -> out, graft(a); same code as v_index
v_index_8 = GhPythonScript(x=find_similar_member_8.Index, y="V")  # -> out, graft(a); same code as v_index
panel_56 = Panel(find_similar_member_8.Index)
panel_57 = Panel(find_similar_member_8.Hit)
panel_58 = Panel(v_index_8.a)
panel_59 = Panel(wo_index.a)

# ----
# Relate Coordinates To Identifiers
panel_60 = Panel(merge_2)
panel_61 = Panel(merge_3)
list_item_9 = ListItem(List=panel_61, Index=1, Wrap=True)  # -> flatten(Item)
list_item_10 = ListItem(List=panel_60, Index=1, Wrap=True)  # -> flatten(Item)
find_similar_member_9 = FindSimilarMember(Data=panel_28, Set=list_item_9)  # -> Hit, Index
find_similar_member_10 = FindSimilarMember(Data=panel_29, Set=list_item_10)  # -> Hit, Index
panel_62 = Panel(find_similar_member_9.Hit)
panel_63 = Panel(find_similar_member_9.Index)
wo_index_2 = GhPythonScript(x=find_similar_member_9.Index, y="WO")  # -> out, graft(a); same code as v_index
v_index_9 = GhPythonScript(x=find_similar_member_10.Index, y="V")  # -> out, graft(a); same code as v_index
panel_64 = Panel(find_similar_member_10.Index)
panel_65 = Panel(find_similar_member_10.Hit)
panel_66 = Panel(v_index_9.a)
panel_67 = Panel(wo_index_2.a)

# ----
# Relate Coordinates To Identifiers
panel_68 = Panel(merge_3)
panel_69 = Panel(merge_2)
list_item_11 = ListItem(List=panel_68, Index=1, Wrap=True)  # -> flatten(Item)
list_item_12 = ListItem(List=panel_69, Index=1, Wrap=True)  # -> flatten(Item)
find_similar_member_11 = FindSimilarMember(Data=panel_25, Set=list_item_11)  # -> Hit, Index
find_similar_member_12 = FindSimilarMember(Data=panel_26, Set=list_item_12)  # -> Hit, Index
panel_70 = Panel(find_similar_member_11.Hit)
panel_71 = Panel(find_similar_member_11.Index)
wo_index_3 = GhPythonScript(x=find_similar_member_11.Index, y="WO")  # -> out, graft(a); same code as v_index
v_index_10 = GhPythonScript(x=find_similar_member_12.Index, y="V")  # -> out, graft(a); same code as v_index
panel_72 = Panel(find_similar_member_12.Index)
panel_73 = Panel(find_similar_member_12.Hit)
panel_74 = Panel(v_index_10.a)
panel_75 = Panel(wo_index_3.a)

# ----
# Waste Source Coordinates
waste_node = Point(graft(create_set.Set))
# Vacant Space Coordinates
vacant_node = Point(point_4)
ghpython_script_13 = GhPythonScript(x=vacant_node)  # -> out, a; inputs x: list of Point3d
# ---------- ghpython_script_13: Python ----------
__author__ = "ereng"
__version__ = "2022.04.19"

import rhinoscriptsyntax as rs


print(x)

for item in x:
    a=tuple(item)
# ---------- end ghpython_script_13 ----------
ghpython_script_14 = GhPythonScript(x=waste_node)  # -> out, a; inputs x: list of Point3d; same code as ghpython_script_13
boolean_toggle_2 = BooleanToggle(False)
panel_76 = Panel(ghpython_script_14.a)
panel_77 = Panel(ghpython_script_13.a)
write_to_excel = WriteToExcel(
    Run=boolean_toggle_2,
    ExcelWorksheet="1",
    ColumnNames=["x", "y", "z"],
    WriteOptions="None",
    ColumnnsOrRows=True,
    DataToWriteIntoColumns=panel_77)
write_to_excel_2 = WriteToExcel(
    Run=boolean_toggle_2,
    ExcelWorksheet="2",
    ColumnNames=["x", "y", "z"],
    WriteOptions="None",
    ColumnnsOrRows=True,
    DataToWriteIntoColumns=panel_76)

# ----
# Write Data To Spreadsheets(.xls)
# Vacant Space Dataset
panel_78 = Panel(merge_2)
# Waste Source Dataset
panel_79 = Panel(merge_3)

# ----
# Export Pairs To Text File
# (V0,WO1)
boolean_toggle_3 = BooleanToggle(False)
create_pairs = GhPythonScript(vacant=panel_58, run=boolean_toggle_3, waste=wo_index.a)  # -> out, flatten(a); inputs vacant: list, run: Boolean, waste: list
# ---------- create_pairs: Python ----------
__author__ = "ereng"
__version__ = "2022.04.17"

fpath_edges="D:\TU DELFT - Master Thesis\UF-DecisionMaker\Edges_try1.txt"

import rhinoscriptsyntax as rs
import ghpythonlib.treehelpers as th
import json

start=[]
end=[]
my_list=[]
for item in vacant:
    for item2 in waste:
        start.append(item)
        end.append(item2)
        c=item,item2
        b=tuple(c)
        list.append(my_list,b)
print(my_list)
a=my_list
# ---------- end create_pairs ----------
panel_80 = Panel(create_pairs.a)
export_to_text_file = GhPythonScript(x=create_pairs.a, run=boolean_toggle)  # -> out, a; inputs x: list
# ---------- export_to_text_file: Python ----------
__author__ = "ereng"
__version__ = "2022.04.28"

import rhinoscriptsyntax as rs
import json
fpath_edges="D:\TU DELFT - Master Thesis\Foodcycle\Edges_try1.txt"

print(x)

if run:
    with open(str(fpath_edges), 'w') as outfile:
            json.dump(x, outfile)
# ---------- end export_to_text_file ----------

# ----
# Export Pairs To Text File
# (V0,WO1)
boolean_toggle_4 = BooleanToggle(False)
create_pairs_2 = GhPythonScript(vacant=panel_74, run=boolean_toggle_4, waste=wo_index_3.a)  # -> out, flatten(a); inputs vacant: list, run: Boolean, waste: list; same code as create_pairs
panel_81 = Panel(create_pairs_2.a)
export_to_text_file_2 = GhPythonScript(x=create_pairs_2.a, run=boolean_toggle)  # -> out, a; inputs x: list
# ---------- export_to_text_file_2: Python ----------
__author__ = "ereng"
__version__ = "2022.04.28"

import rhinoscriptsyntax as rs
import json
fpath_edges="D:\TU DELFT - Master Thesis\Foodcycle\Edges_try3.txt"

print(x)

if run:
    with open(str(fpath_edges), 'w') as outfile:
            json.dump(x, outfile)
# ---------- end export_to_text_file_2 ----------

# ----
# Export Pairs To Text File
# (V0,WO1)
boolean_toggle_5 = BooleanToggle(False)
create_pairs_3 = GhPythonScript(vacant=panel_66, run=boolean_toggle_5, waste=wo_index_2.a)  # -> out, flatten(a); inputs vacant: list, run: Boolean, waste: list; same code as create_pairs
panel_82 = Panel(create_pairs_3.a)
export_to_text_file_3 = GhPythonScript(x=create_pairs_3.a, run=boolean_toggle)  # -> out, a; inputs x: list
# ---------- export_to_text_file_3: Python ----------
__author__ = "ereng"
__version__ = "2022.04.28"

import rhinoscriptsyntax as rs
import json
fpath_edges="D:\TU DELFT - Master Thesis\Foodcycle\Edges_try2.txt"

print(x)

if run:
    with open(str(fpath_edges), 'w') as outfile:
            json.dump(x, outfile)
# ---------- end export_to_text_file_3 ----------

# ----
# Export Pairs To Text File
# (V0,V1)
boolean_toggle_6 = BooleanToggle(False)
create_pairs_4 = GhPythonScript(vacant=panel_50, run=boolean_toggle_6, waste=v_index_6.a)  # -> out, flatten(a); inputs vacant: list, run: Boolean, waste: list; same code as create_pairs
panel_83 = Panel(create_pairs_4.a)
export_to_text_file_4 = GhPythonScript(x=create_pairs_4.a, run=boolean_toggle)  # -> out, a; inputs x: list
# ---------- export_to_text_file_4: Python ----------
__author__ = "ereng"
__version__ = "2022.04.28"

import rhinoscriptsyntax as rs
import json

fpath_edges="D:\TU DELFT - Master Thesis\Foodcyle\Edges_vacant200.txt"

print(x)

if run:
    with open(str(fpath_edges), 'w') as outfile:
            json.dump(x, outfile)
# ---------- end export_to_text_file_4 ----------

# ----
# Export Pairs To Text File
# (V0,V1)
boolean_toggle_7 = BooleanToggle(False)
create_pairs_5 = GhPythonScript(vacant=panel_43, run=boolean_toggle_7, waste=v_index_4.a)  # -> out, flatten(a); inputs vacant: list, run: Boolean, waste: list; same code as create_pairs
panel_84 = Panel(create_pairs_5.a)
export_to_text_file_5 = GhPythonScript(x=create_pairs_5.a, run=boolean_toggle)  # -> out, a; inputs x: list
# ---------- export_to_text_file_5: Python ----------
__author__ = "ereng"
__version__ = "2022.04.28"

import rhinoscriptsyntax as rs
import json

fpath_edges="D:\TU DELFT - Master Thesis\Foodcyle\Edges_vacant300.txt"

print(x)

if run:
    with open(str(fpath_edges), 'w') as outfile:
            json.dump(x, outfile)
# ---------- end export_to_text_file_5 ----------

# ----
# Export Data
# Export Pairs To Text File
# (V0,V1)
boolean_toggle_8 = BooleanToggle(False)
create_pairs_6 = GhPythonScript(vacant=panel_36, run=boolean_toggle_8, waste=v_index_2.a)  # -> out, flatten(a); inputs vacant: list, run: Boolean, waste: list; same code as create_pairs
panel_85 = Panel(create_pairs_6.a)
export_to_text_file_6 = GhPythonScript(x=create_pairs_6.a, run=boolean_toggle)  # -> out, a; inputs x: list
# ---------- export_to_text_file_6: Python ----------
__author__ = "ereng"
__version__ = "2022.04.28"

import rhinoscriptsyntax as rs
import json

fpath_edges="D:\TU DELFT - Master Thesis\Foodcyle\Edges_vacant100.txt"

print(x)

if run:
    with open(str(fpath_edges), 'w') as outfile:
            json.dump(x, outfile)
# ---------- end export_to_text_file_6 ----------

boolean_toggle_9 = BooleanToggle(False)
write_to_excel_3 = WriteToExcel(
    Run=boolean_toggle_9,
    ExcelWorksheet="1",
    ColumnNames=["Identifier", "Coordinates", "Size"],
    WriteOptions="None",
    ColumnnsOrRows=True,
    DataToWriteIntoColumns=panel_78)
write_to_excel_4 = WriteToExcel(
    Run=boolean_toggle_9,
    ExcelWorksheet="2",
    ColumnNames=["Identifier", "Coordinates"],
    WriteOptions="None",
    ColumnnsOrRows=True,
    DataToWriteIntoColumns=panel_79)

panel_86 = Panel("\"D:\\TU DELFT - Master Thesis\\Foodcycle\\new_edges_dict4.txt\"")
file_path_3 = FilePath(panel_86)
ghpython_script_15 = GhPythonScript(coordinates_file=file_path_3, run=Toggle(True))  # -> out, graft(start_x), graft(start_y), graft(end_x), graft(end_y), graft(type)
# ---------- ghpython_script_15: Python ----------
__author__ = "ereng"
__version__ = "2022.04.18"

import rhinoscriptsyntax as rs

from ghpythonlib import treehelpers as th
import json

def to_raw(string):
    string = string.replace("\"", "")
    return r"{}".format(string)

coordinates_file = to_raw(coordinates_file)

print("Occupied nodes path: " + coordinates_file)

#reading exported Nodes JSON file
if run:
    with open(str(coordinates_file)) as json_file_nodes:
        coordinates = json.load(json_file_nodes)
    
print(coordinates)

start1=[]
start2=[]
end1=[]
end2=[]
type=[]
for index in coordinates:
    s1= coordinates[index]["connection"][0][0]
    s2=coordinates[index]["connection"][0][1]
    e1=coordinates[index]["connection"][1][0]
    e2=coordinates[index]["connection"][1][1]
    type2=coordinates[index]["type"]
    start1.append(s1)
    start2.append(s2)
    end1.append(e1)
    end2.append(e2)
    type.append(type2)

start_x=start1
start_y=start2
end_x=end1
end_y=end2
type=type
# ---------- end ghpython_script_15 ----------

panel_87 = Panel("\"D:\\TU DELFT - Master Thesis\\Foodcycle\\occupied nodes3.txt\"")
file_path_4 = FilePath(panel_87)
import_occupied_spaces = GhPythonScript(occupied_nodes=file_path_4, run=Toggle(True))  # -> out, flatten(uf_system), coordinates, flatten(vacant_space), a
# ---------- import_occupied_spaces: Python ----------
__author__ = "ereng"
__version__ = "2022.04.18"

import rhinoscriptsyntax as rs

from ghpythonlib import treehelpers as th
import json

def to_raw(string):
    string = string.replace("\"", "")
    return r"{}".format(string)

occupied_nodes = to_raw(occupied_nodes)

print("Occupied nodes path: " + occupied_nodes)

#reading exported Nodes JSON file
if run:
    with open(str(occupied_nodes)) as json_file_nodes:
        nodes = json.load(json_file_nodes)
#        print(nodes)
uf=[]
spaces=[]
coordinate=[]
order=[]
for space in nodes:
    if nodes[space]["system"]!=None:
        print(space,nodes[space]["location"],nodes[space]["system"])
        list.append(uf,nodes[space]["system"])
        list.append(spaces,space)
        list.append(coordinate,(nodes[space]["location"]))
#print(coordinate)
#print(spaces)


uf_system=uf
vacant_space=spaces
coordinates=coordinate
newitem2=[]
# ---------- end import_occupied_spaces ----------

panel_88 = Panel("\"D:\\TU DELFT - Master Thesis\\Foodcycle\\new_edges_dict3.txt\"")
file_path_5 = FilePath(panel_88)
ghpython_script_16 = GhPythonScript(coordinates_file=file_path_5, run=Toggle(True))  # -> out, graft(start_x), graft(start_y), graft(end_x), graft(end_y), graft(type); same code as ghpython_script_15

panel_89 = Panel("\"D:\\TU DELFT - Master Thesis\\Foodcycle\\occupied nodes4.txt\"")
file_path_6 = FilePath(panel_89)
import_occupied_spaces_2 = GhPythonScript(occupied_nodes=file_path_6, run=Toggle(True))  # -> out, flatten(uf_system), coordinates, flatten(vacant_space), a; same code as import_occupied_spaces

panel_90 = Panel("\"D:\\TU DELFT - Master Thesis\\Foodcycle\\occupied nodes2.txt\"")
file_path_7 = FilePath(panel_90)
import_occupied_spaces_3 = GhPythonScript(occupied_nodes=file_path_7, run=Toggle(True))  # -> out, flatten(uf_system), coordinates, flatten(vacant_space), a; same code as import_occupied_spaces

panel_91 = Panel("\"D:\\TU DELFT - Master Thesis\\Foodcycle\\new_edges_dict2.txt\"")
file_path_8 = FilePath(panel_91)
ghpython_script_17 = GhPythonScript(coordinates_file=file_path_8, run=Toggle(True))  # -> out, graft(start_x), graft(start_y), graft(end_x), graft(end_y), graft(type); same code as ghpython_script_15

panel_92 = Panel("\"D:\\TU DELFT - Master Thesis\\Foodcycle\\new_edges_dict.txt\"")
file_path_9 = FilePath(panel_92)
ghpython_script_18 = GhPythonScript(coordinates_file=file_path_9, run=Toggle(True))  # -> out, graft(start_x), graft(start_y), graft(end_x), graft(end_y), graft(type); same code as ghpython_script_15

# ----
# Import Decisions
panel_93 = Panel("\"D:\\TU DELFT - Master Thesis\\Foodcycle\\occupied nodes.txt\"")
file_path_10 = FilePath(panel_93)
import_occupied_spaces_4 = GhPythonScript(occupied_nodes=file_path_10, run=Toggle(True))  # -> out, flatten(uf_system), coordinates, flatten(vacant_space), a; same code as import_occupied_spaces

construct_point_5 = ConstructPoint(XCoordinate=ghpython_script_15.end_x, YCoordinate=ghpython_script_15.end_y, ZCoordinate=0)
construct_point_6 = ConstructPoint(XCoordinate=ghpython_script_15.start_x, YCoordinate=ghpython_script_15.start_y, ZCoordinate=0)
point_5 = Point(construct_point_6)
point_6 = Point(construct_point_5)
panel_94 = Panel(construct_point_5)
# Import Waste Exchange
panel_95 = Panel(point_5)
line_14 = Line(StartPoint=point_5, EndPoint=point_6)
panel_96 = Panel(ghpython_script_15.type)
curve_middle_2 = CurveMiddle(Curve=line_14)
unit_z_2 = UnitZ(Factor=Slider(22, range=0..50))
move_2 = Move(Geometry=curve_middle_2, Motion=unit_z_2)  # -> Geometry, Transform
integer_in_w_integer = GhPythonScript(x=panel_96, run=Toggle(True))  # -> out, a, b; inputs run: Boolean
# ---------- integer_in_w_integer: Python ----------
__author__ = "ereng"
__version__ = "2022.04.21"

import rhinoscriptsyntax as rs
print x
for item in x:
    if x[0]=="W":
        a=x[1]
    if x[0]=="S":
        b=x[1]
# ---------- end integer_in_w_integer ----------
merge_4 = Merge(Data1=point_5, Data2=move_2.Geometry, Data3=point_6)
panel_97 = Panel(integer_in_w_integer.a)

construct_point_7 = ConstructPoint(XCoordinate=ghpython_script_17.end_x, YCoordinate=ghpython_script_17.end_y, ZCoordinate=0)
# Import Waste Exchange
construct_point_8 = ConstructPoint(XCoordinate=ghpython_script_17.start_x, YCoordinate=ghpython_script_17.start_y, ZCoordinate=0)
point_7 = Point(construct_point_8)
point_8 = Point(construct_point_7)
panel_98 = Panel(construct_point_7)
panel_99 = Panel(point_7)
line_15 = Line(StartPoint=point_7, EndPoint=point_8)
panel_100 = Panel(ghpython_script_17.type)
curve_middle_3 = CurveMiddle(Curve=line_15)
unit_z_3 = UnitZ(Factor=Slider(22, range=0..50))
move_3 = Move(Geometry=curve_middle_3, Motion=unit_z_3)  # -> Geometry, Transform
integer_in_w_integer_2 = GhPythonScript(x=panel_100, run=Toggle(True))  # -> out, a, b; inputs run: Boolean; same code as integer_in_w_integer
merge_5 = Merge(Data1=point_7, Data2=move_3.Geometry, Data3=point_8)
panel_101 = Panel(integer_in_w_integer_2.a)

construct_point_9 = ConstructPoint(XCoordinate=ghpython_script_18.end_x, YCoordinate=ghpython_script_18.end_y, ZCoordinate=0)
# Import Waste Exchange
construct_point_10 = ConstructPoint(XCoordinate=ghpython_script_18.start_x, YCoordinate=ghpython_script_18.start_y, ZCoordinate=0)
point_9 = Point(construct_point_10)
point_10 = Point(construct_point_9)
panel_102 = Panel(construct_point_9)
panel_103 = Panel(point_9)
line_16 = Line(StartPoint=point_9, EndPoint=point_10)
panel_104 = Panel(ghpython_script_18.type)
curve_middle_4 = CurveMiddle(Curve=line_16)
unit_z_4 = UnitZ(Factor=Slider(22, range=0..50))
move_4 = Move(Geometry=curve_middle_4, Motion=unit_z_4)  # -> Geometry, Transform
integer_in_w_integer_3 = GhPythonScript(x=panel_104, run=Toggle(True))  # -> out, a, b; inputs run: Boolean; same code as integer_in_w_integer
merge_6 = Merge(Data1=point_9, Data2=move_4.Geometry, Data3=point_10)
panel_105 = Panel(integer_in_w_integer_3.a)

construct_point_11 = ConstructPoint(XCoordinate=ghpython_script_16.end_x, YCoordinate=ghpython_script_16.end_y, ZCoordinate=0)
# Import Waste Exchange
construct_point_12 = ConstructPoint(XCoordinate=ghpython_script_16.start_x, YCoordinate=ghpython_script_16.start_y, ZCoordinate=0)
point_11 = Point(construct_point_12)
point_12 = Point(construct_point_11)
panel_106 = Panel(construct_point_11)
panel_107 = Panel(point_11)
line_17 = Line(StartPoint=point_11, EndPoint=point_12)
panel_108 = Panel(ghpython_script_16.type)
curve_middle_5 = CurveMiddle(Curve=line_17)
unit_z_5 = UnitZ(Factor=Slider(22, range=0..50))
move_5 = Move(Geometry=curve_middle_5, Motion=unit_z_5)  # -> Geometry, Transform
integer_in_w_integer_4 = GhPythonScript(x=panel_108, run=Toggle(True))  # -> out, a, b; inputs run: Boolean; same code as integer_in_w_integer
merge_7 = Merge(Data1=point_11, Data2=move_5.Geometry, Data3=point_12)
panel_109 = Panel(integer_in_w_integer_4.a)

# ----
# Draw Connections
interpolate_2 = Interpolate(Vertices=merge_5, Degree=3, Periodic=False, KnotStyle=1)  # -> Curve, Length, Domain
length_7 = Length(Curve=interpolate_2.Curve)
polyline_2 = PolyLine(Vertices=merge_5, Closed=False)
perp_frames = PerpFrames(Curve=interpolate_2.Curve, Count=length_7, Align=True)  # -> Frames, Parameters
list_length = ListLength(List=perp_frames.Frames)
subtraction = Subtraction(A=list_length, B=Slider(1, range=0..10))
curve_frame = CurveFrame(Curve=polyline_2, Parameter=Slider(2, range=0..100))
number_slider_5 = Slider(10, range=0..10)
list_item_13 = ListItem(List=perp_frames.Frames, Index=subtraction, Wrap=True)
rotate_3d = Rotate3D(Geometry=list_item_13, Angle=degrees(360), Center=point_8, Axis=curve_frame)  # -> Geometry, Transform
division = Division(A=number_slider_5, B=Slider(3, range=0..10))
cone = Cone(Base=rotate_3d.Geometry, Radius=division, Length=number_slider_5)  # -> Cone, Tip
sphere_2 = Sphere(Base=point_7, Radius=division)  # -> graft(Sphere)
pipe_2 = Pipe(Curve=interpolate_2.Curve, Radius=Slider(1, range=0..10), Caps=1)
cap_holes = CapHoles(Brep=cone.Cone)
merge_8 = Merge(Data1=cap_holes, Data2=sphere_2, Data3=pipe_2)
vector_xyz = VectorXYZ(XComponent=0, YComponent=0, ZComponent=Slider(10, range=0..10))  # -> Vector, Length
move_6 = Move(Geometry=merge_8, Motion=vector_xyz.Vector)  # -> Geometry, Transform
label_waste_type = TextTag(Location=point_7, Text=panel_100, Colour=RGB(0, 0, 0))

# ----
# Draw Connections
interpolate_3 = Interpolate(Vertices=merge_6, Degree=3, Periodic=False, KnotStyle=1)  # -> Curve, Length, Domain
length_8 = Length(Curve=interpolate_3.Curve)
polyline_3 = PolyLine(Vertices=merge_6, Closed=False)
perp_frames_2 = PerpFrames(Curve=interpolate_3.Curve, Count=length_8, Align=True)  # -> Frames, Parameters
list_length_2 = ListLength(List=perp_frames_2.Frames)
subtraction_2 = Subtraction(A=list_length_2, B=Slider(1, range=0..10))
curve_frame_2 = CurveFrame(Curve=polyline_3, Parameter=Slider(2, range=0..100))
number_slider_6 = Slider(10, range=0..10)
list_item_14 = ListItem(List=perp_frames_2.Frames, Index=subtraction_2, Wrap=True)
rotate_3d_2 = Rotate3D(Geometry=list_item_14, Angle=degrees(360), Center=point_10, Axis=curve_frame_2)  # -> Geometry, Transform
division_2 = Division(A=number_slider_6, B=Slider(3, range=0..10))
cone_2 = Cone(Base=rotate_3d_2.Geometry, Radius=division_2, Length=number_slider_6)  # -> Cone, Tip
sphere_3 = Sphere(Base=point_9, Radius=division_2)  # -> graft(Sphere)
pipe_3 = Pipe(Curve=interpolate_3.Curve, Radius=Slider(1, range=0..10), Caps=1)
cap_holes_2 = CapHoles(Brep=cone_2.Cone)
merge_9 = Merge(Data1=cap_holes_2, Data2=sphere_3, Data3=pipe_3)
vector_xyz_2 = VectorXYZ(XComponent=0, YComponent=0, ZComponent=Slider(10, range=0..10))  # -> Vector, Length
move_7 = Move(Geometry=merge_9, Motion=vector_xyz_2.Vector)  # -> Geometry, Transform
label_waste_type_2 = TextTag(Location=point_9, Text=panel_104, Colour=RGB(0, 0, 0))

# ----
# Draw Connections
interpolate_4 = Interpolate(Vertices=merge_7, Degree=3, Periodic=False, KnotStyle=1)  # -> Curve, Length, Domain
length_9 = Length(Curve=interpolate_4.Curve)
polyline_4 = PolyLine(Vertices=merge_7, Closed=False)
perp_frames_3 = PerpFrames(Curve=interpolate_4.Curve, Count=length_9, Align=True)  # -> Frames, Parameters
list_length_3 = ListLength(List=perp_frames_3.Frames)
subtraction_3 = Subtraction(A=list_length_3, B=Slider(1, range=0..10))
curve_frame_3 = CurveFrame(Curve=polyline_4, Parameter=Slider(2, range=0..100))
number_slider_7 = Slider(10, range=0..10)
list_item_15 = ListItem(List=perp_frames_3.Frames, Index=subtraction_3, Wrap=True)
rotate_3d_3 = Rotate3D(Geometry=list_item_15, Angle=degrees(360), Center=point_12, Axis=curve_frame_3)  # -> Geometry, Transform
division_3 = Division(A=number_slider_7, B=Slider(3, range=0..10))
cone_3 = Cone(Base=rotate_3d_3.Geometry, Radius=division_3, Length=number_slider_7)  # -> Cone, Tip
sphere_4 = Sphere(Base=point_11, Radius=division_3)  # -> graft(Sphere)
pipe_4 = Pipe(Curve=interpolate_4.Curve, Radius=Slider(1, range=0..10), Caps=1)
cap_holes_3 = CapHoles(Brep=cone_3.Cone)
merge_10 = Merge(Data1=cap_holes_3, Data2=sphere_4, Data3=pipe_4)
vector_xyz_3 = VectorXYZ(XComponent=0, YComponent=0, ZComponent=Slider(10, range=0..10))  # -> Vector, Length
move_8 = Move(Geometry=merge_10, Motion=vector_xyz_3.Vector)  # -> Geometry, Transform
label_waste_type_3 = TextTag(Location=point_11, Text=panel_108, Colour=RGB(0, 0, 0))

# ----
# Draw Connections
interpolate_5 = Interpolate(Vertices=merge_4, Degree=3, Periodic=False, KnotStyle=1)  # -> Curve, Length, Domain
length_10 = Length(Curve=interpolate_5.Curve)
polyline_5 = PolyLine(Vertices=merge_4, Closed=False)
perp_frames_4 = PerpFrames(Curve=interpolate_5.Curve, Count=length_10, Align=True)  # -> Frames, Parameters
list_length_4 = ListLength(List=perp_frames_4.Frames)
subtraction_4 = Subtraction(A=list_length_4, B=Slider(1, range=0..10))
curve_frame_4 = CurveFrame(Curve=polyline_5, Parameter=Slider(2, range=0..100))
number_slider_8 = Slider(10, range=0..10)
list_item_16 = ListItem(List=perp_frames_4.Frames, Index=subtraction_4, Wrap=True)
rotate_3d_4 = Rotate3D(Geometry=list_item_16, Angle=degrees(360), Center=point_6, Axis=curve_frame_4)  # -> Geometry, Transform
division_4 = Division(A=number_slider_8, B=Slider(3, range=0..10))
cone_4 = Cone(Base=rotate_3d_4.Geometry, Radius=division_4, Length=number_slider_8)  # -> Cone, Tip
sphere_5 = Sphere(Base=point_5, Radius=division_4)  # -> graft(Sphere)
pipe_5 = Pipe(Curve=interpolate_5.Curve, Radius=Slider(1, range=0..10), Caps=1)
cap_holes_4 = CapHoles(Brep=cone_4.Cone)
merge_11 = Merge(Data1=cap_holes_4, Data2=sphere_5, Data3=pipe_5)
vector_xyz_4 = VectorXYZ(XComponent=0, YComponent=0, ZComponent=Slider(10, range=0..10))  # -> Vector, Length
move_9 = Move(Geometry=merge_11, Motion=vector_xyz_4.Vector)  # -> Geometry, Transform
label_waste_type_4 = TextTag(Location=point_5, Text=panel_96, Colour=RGB(0, 0, 0))

colour_swatch = ColourSwatch(SwatchColor=RGB(245, 53, 0))
colour_swatch_2 = ColourSwatch(SwatchColor=RGB(0, 0, 0))
colour_swatch_3 = ColourSwatch(SwatchColor=RGB(0, 42, 194))
colour_swatch_4 = ColourSwatch(SwatchColor=RGB(99, 0, 166))
colour_swatch_5 = ColourSwatch(SwatchColor=RGB(0, 51, 1))
colour_swatch_6 = ColourSwatch(SwatchColor=RGB(149, 255, 0))
colour_swatch_7 = ColourSwatch(SwatchColor=RGB(4, 255, 0))
colour_swatch_8 = ColourSwatch(SwatchColor=RGB(138, 0, 126))
colour_swatch_9 = ColourSwatch(SwatchColor=RGB(250, 233, 0))

colour_swatch_10 = ColourSwatch(SwatchColor=RGB(255, 0, 0))
colour_swatch_11 = ColourSwatch(SwatchColor=RGB(0, 128, 97))
colour_swatch_12 = ColourSwatch(SwatchColor=RGB(245, 0, 220))
colour_swatch_13 = ColourSwatch(SwatchColor=RGB(180, 0, 255))
colour_swatch_14 = ColourSwatch(SwatchColor=RGB(78, 255, 255))
colour_swatch_15 = ColourSwatch(SwatchColor=RGB(0, 255, 14))
colour_swatch_16 = ColourSwatch(SwatchColor=RGB(255, 255, 16))
colour_swatch_17 = ColourSwatch(SwatchColor=RGB(255, 116, 0))
colour_swatch_18 = ColourSwatch(SwatchColor=RGB(124, 0, 168))
colour_swatch_19 = ColourSwatch(SwatchColor=RGB(27, 0, 191))

# ----
# Represent Waste Types With Colors
number_slider_9 = Slider(1, range=0..10)
equality = Equality(FirstNumber=integer_in_w_integer_2.a, SecondNumber=number_slider_9)  # -> Equality, Inequality
equality_2 = Equality(FirstNumber=integer_in_w_integer_2.a, SecondNumber=Slider(2, range=0..10))  # -> Equality, Inequality
equality_3 = Equality(FirstNumber=integer_in_w_integer_2.a, SecondNumber=Slider(3, range=0..10))  # -> Equality, Inequality
equality_4 = Equality(FirstNumber=integer_in_w_integer_2.a, SecondNumber=Slider(4, range=0..10))  # -> Equality, Inequality
equality_5 = Equality(FirstNumber=integer_in_w_integer_2.a, SecondNumber=Slider(5, range=0..10))  # -> Equality, Inequality
equality_6 = Equality(FirstNumber=integer_in_w_integer_2.a, SecondNumber=Slider(6, range=0..10))  # -> Equality, Inequality
equality_7 = Equality(FirstNumber=integer_in_w_integer_2.a, SecondNumber=Slider(7, range=0..10))  # -> Equality, Inequality
equality_8 = Equality(FirstNumber=integer_in_w_integer_2.b, SecondNumber=Slider(2, range=0..10))  # -> Equality, Inequality
equality_9 = Equality(FirstNumber=integer_in_w_integer_2.b, SecondNumber=Slider(4, range=0..10))  # -> Equality, Inequality
equality_10 = Equality(FirstNumber=integer_in_w_integer_2.b, SecondNumber=Slider(5, range=0..10))  # -> Equality, Inequality
food_waste = CullPattern(List=move_6.Geometry, CullPattern=equality.Equality)
sawdust = CullPattern(List=move_6.Geometry, CullPattern=equality_2.Equality)
paper_waste = CullPattern(List=move_6.Geometry, CullPattern=equality_3.Equality)
coffee_waste = CullPattern(List=move_6.Geometry, CullPattern=equality_4.Equality)
co2 = CullPattern(List=move_6.Geometry, CullPattern=equality_5.Equality)
rainwater = CullPattern(List=move_6.Geometry, CullPattern=equality_6.Equality)
residual_heat = CullPattern(List=move_6.Geometry, CullPattern=equality_7.Equality)
cull_pattern_4 = CullPattern(List=move_6.Geometry, CullPattern=equality_8.Equality)
cull_pattern_5 = CullPattern(List=move_6.Geometry, CullPattern=equality_9.Equality)
cull_pattern_6 = CullPattern(List=move_6.Geometry, CullPattern=equality_10.Equality)
custom_preview_2 = CustomPreview(Geometry=sawdust, Material=colour_swatch_13)  # disabled
custom_preview_3 = CustomPreview(Geometry=food_waste, Material=colour_swatch_12)  # disabled
custom_preview_4 = CustomPreview(Geometry=cull_pattern_6, Material=colour_swatch_11)  # disabled
custom_preview_5 = CustomPreview(Geometry=paper_waste, Material=colour_swatch_14)  # disabled
custom_preview_6 = CustomPreview(Geometry=coffee_waste, Material=colour_swatch_15)  # disabled
custom_preview_7 = CustomPreview(Geometry=rainwater, Material=colour_swatch_17)  # disabled
custom_preview_8 = CustomPreview(Geometry=co2, Material=colour_swatch_16)  # disabled
custom_preview_9 = CustomPreview(Geometry=residual_heat, Material=colour_swatch_10)  # disabled
custom_preview_10 = CustomPreview(Geometry=cull_pattern_5, Material=colour_swatch_19)  # disabled
custom_preview_11 = CustomPreview(Geometry=cull_pattern_4, Material=colour_swatch_18)  # disabled

# ----
# Represent Waste Types With Colors
number_slider_10 = Slider(1, range=0..10)
equality_11 = Equality(FirstNumber=integer_in_w_integer_3.a, SecondNumber=number_slider_10)  # -> Equality, Inequality
equality_12 = Equality(FirstNumber=integer_in_w_integer_3.a, SecondNumber=Slider(2, range=0..10))  # -> Equality, Inequality
equality_13 = Equality(FirstNumber=integer_in_w_integer_3.a, SecondNumber=Slider(3, range=0..10))  # -> Equality, Inequality
equality_14 = Equality(FirstNumber=integer_in_w_integer_3.a, SecondNumber=Slider(4, range=0..10))  # -> Equality, Inequality
equality_15 = Equality(FirstNumber=integer_in_w_integer_3.a, SecondNumber=Slider(5, range=0..10))  # -> Equality, Inequality
equality_16 = Equality(FirstNumber=integer_in_w_integer_3.a, SecondNumber=Slider(6, range=0..10))  # -> Equality, Inequality
equality_17 = Equality(FirstNumber=integer_in_w_integer_3.a, SecondNumber=Slider(7, range=0..10))  # -> Equality, Inequality
equality_18 = Equality(FirstNumber=integer_in_w_integer_3.b, SecondNumber=Slider(2, range=0..10))  # -> Equality, Inequality
equality_19 = Equality(FirstNumber=integer_in_w_integer_3.b, SecondNumber=Slider(4, range=0..10))  # -> Equality, Inequality
equality_20 = Equality(FirstNumber=integer_in_w_integer_3.b, SecondNumber=Slider(5, range=0..10))  # -> Equality, Inequality
food_waste_2 = CullPattern(List=move_7.Geometry, CullPattern=equality_11.Equality)
sawdust_2 = CullPattern(List=move_7.Geometry, CullPattern=equality_12.Equality)
paper_waste_2 = CullPattern(List=move_7.Geometry, CullPattern=equality_13.Equality)
coffee_waste_2 = CullPattern(List=move_7.Geometry, CullPattern=equality_14.Equality)
co2_2 = CullPattern(List=move_7.Geometry, CullPattern=equality_15.Equality)
rainwater_2 = CullPattern(List=move_7.Geometry, CullPattern=equality_16.Equality)
residual_heat_2 = CullPattern(List=move_7.Geometry, CullPattern=equality_17.Equality)
cull_pattern_7 = CullPattern(List=move_7.Geometry, CullPattern=equality_18.Equality)
cull_pattern_8 = CullPattern(List=move_7.Geometry, CullPattern=equality_19.Equality)
cull_pattern_9 = CullPattern(List=move_7.Geometry, CullPattern=equality_20.Equality)
custom_preview_12 = CustomPreview(Geometry=sawdust_2, Material=colour_swatch_13)  # disabled
custom_preview_13 = CustomPreview(Geometry=food_waste_2, Material=colour_swatch_12)  # disabled
custom_preview_14 = CustomPreview(Geometry=cull_pattern_9, Material=colour_swatch_11)  # disabled
custom_preview_15 = CustomPreview(Geometry=paper_waste_2, Material=colour_swatch_14)  # disabled
custom_preview_16 = CustomPreview(Geometry=coffee_waste_2, Material=colour_swatch_15)  # disabled
custom_preview_17 = CustomPreview(Geometry=rainwater_2, Material=colour_swatch_17)  # disabled
custom_preview_18 = CustomPreview(Geometry=co2_2, Material=colour_swatch_16)  # disabled
custom_preview_19 = CustomPreview(Geometry=residual_heat_2, Material=colour_swatch_10)  # disabled
custom_preview_20 = CustomPreview(Geometry=cull_pattern_8, Material=colour_swatch_19)  # disabled
custom_preview_21 = CustomPreview(Geometry=cull_pattern_7, Material=colour_swatch_18)  # disabled

# ----
# Represent Waste Types With Colors
number_slider_11 = Slider(1, range=0..10)
equality_21 = Equality(FirstNumber=integer_in_w_integer_4.a, SecondNumber=number_slider_11)  # -> Equality, Inequality
equality_22 = Equality(FirstNumber=integer_in_w_integer_4.a, SecondNumber=Slider(2, range=0..10))  # -> Equality, Inequality
equality_23 = Equality(FirstNumber=integer_in_w_integer_4.a, SecondNumber=Slider(3, range=0..10))  # -> Equality, Inequality
equality_24 = Equality(FirstNumber=integer_in_w_integer_4.a, SecondNumber=Slider(4, range=0..10))  # -> Equality, Inequality
equality_25 = Equality(FirstNumber=integer_in_w_integer_4.a, SecondNumber=Slider(5, range=0..10))  # -> Equality, Inequality
equality_26 = Equality(FirstNumber=integer_in_w_integer_4.a, SecondNumber=Slider(6, range=0..10))  # -> Equality, Inequality
equality_27 = Equality(FirstNumber=integer_in_w_integer_4.a, SecondNumber=Slider(7, range=0..10))  # -> Equality, Inequality
equality_28 = Equality(FirstNumber=integer_in_w_integer_4.b, SecondNumber=Slider(2, range=0..10))  # -> Equality, Inequality
equality_29 = Equality(FirstNumber=integer_in_w_integer_4.b, SecondNumber=Slider(4, range=0..10))  # -> Equality, Inequality
equality_30 = Equality(FirstNumber=integer_in_w_integer_4.b, SecondNumber=Slider(5, range=0..10))  # -> Equality, Inequality
food_waste_3 = CullPattern(List=move_8.Geometry, CullPattern=equality_21.Equality)
sawdust_3 = CullPattern(List=move_8.Geometry, CullPattern=equality_22.Equality)
paper_waste_3 = CullPattern(List=move_8.Geometry, CullPattern=equality_23.Equality)
coffee_waste_3 = CullPattern(List=move_8.Geometry, CullPattern=equality_24.Equality)
co2_3 = CullPattern(List=move_8.Geometry, CullPattern=equality_25.Equality)
rainwater_3 = CullPattern(List=move_8.Geometry, CullPattern=equality_26.Equality)
residual_heat_3 = CullPattern(List=move_8.Geometry, CullPattern=equality_27.Equality)
cull_pattern_10 = CullPattern(List=move_8.Geometry, CullPattern=equality_28.Equality)
cull_pattern_11 = CullPattern(List=move_8.Geometry, CullPattern=equality_29.Equality)
cull_pattern_12 = CullPattern(List=move_8.Geometry, CullPattern=equality_30.Equality)
custom_preview_22 = CustomPreview(Geometry=food_waste_3, Material=colour_swatch_12)  # disabled
custom_preview_23 = CustomPreview(Geometry=sawdust_3, Material=colour_swatch_13)  # disabled
custom_preview_24 = CustomPreview(Geometry=cull_pattern_12, Material=colour_swatch_11)  # disabled
custom_preview_25 = CustomPreview(Geometry=paper_waste_3, Material=colour_swatch_14)  # disabled
custom_preview_26 = CustomPreview(Geometry=coffee_waste_3, Material=colour_swatch_15)  # disabled
custom_preview_27 = CustomPreview(Geometry=rainwater_3, Material=colour_swatch_17)  # disabled
custom_preview_28 = CustomPreview(Geometry=co2_3, Material=colour_swatch_16)  # disabled
custom_preview_29 = CustomPreview(Geometry=residual_heat_3, Material=colour_swatch_10)  # disabled
custom_preview_30 = CustomPreview(Geometry=cull_pattern_11, Material=colour_swatch_19)  # disabled
custom_preview_31 = CustomPreview(Geometry=cull_pattern_10, Material=colour_swatch_18)  # disabled

# ----
# Represent Waste Types With Colors
number_slider_12 = Slider(1, range=0..10)
equality_31 = Equality(FirstNumber=integer_in_w_integer.a, SecondNumber=number_slider_12)  # -> Equality, Inequality
equality_32 = Equality(FirstNumber=integer_in_w_integer.a, SecondNumber=Slider(2, range=0..10))  # -> Equality, Inequality
equality_33 = Equality(FirstNumber=integer_in_w_integer.a, SecondNumber=Slider(3, range=0..10))  # -> Equality, Inequality
equality_34 = Equality(FirstNumber=integer_in_w_integer.a, SecondNumber=Slider(4, range=0..10))  # -> Equality, Inequality
equality_35 = Equality(FirstNumber=integer_in_w_integer.a, SecondNumber=Slider(5, range=0..10))  # -> Equality, Inequality
equality_36 = Equality(FirstNumber=integer_in_w_integer.a, SecondNumber=Slider(6, range=0..10))  # -> Equality, Inequality
equality_37 = Equality(FirstNumber=integer_in_w_integer.a, SecondNumber=Slider(7, range=0..10))  # -> Equality, Inequality
equality_38 = Equality(FirstNumber=integer_in_w_integer.b, SecondNumber=Slider(2, range=0..10))  # -> Equality, Inequality
equality_39 = Equality(FirstNumber=integer_in_w_integer.b, SecondNumber=Slider(4, range=0..10))  # -> Equality, Inequality
equality_40 = Equality(FirstNumber=integer_in_w_integer.b, SecondNumber=Slider(5, range=0..10))  # -> Equality, Inequality
food_waste_4 = CullPattern(List=move_9.Geometry, CullPattern=equality_31.Equality)
sawdust_4 = CullPattern(List=move_9.Geometry, CullPattern=equality_32.Equality)
paper_waste_4 = CullPattern(List=move_9.Geometry, CullPattern=equality_33.Equality)
coffee_waste_4 = CullPattern(List=move_9.Geometry, CullPattern=equality_34.Equality)
co2_4 = CullPattern(List=move_9.Geometry, CullPattern=equality_35.Equality)
rainwater_4 = CullPattern(List=move_9.Geometry, CullPattern=equality_36.Equality)
residual_heat_4 = CullPattern(List=move_9.Geometry, CullPattern=equality_37.Equality)
cull_pattern_13 = CullPattern(List=move_9.Geometry, CullPattern=equality_38.Equality)
cull_pattern_14 = CullPattern(List=move_9.Geometry, CullPattern=equality_39.Equality)
cull_pattern_15 = CullPattern(List=move_9.Geometry, CullPattern=equality_40.Equality)
custom_preview_32 = CustomPreview(Geometry=sawdust_4, Material=colour_swatch_13)  # disabled
custom_preview_33 = CustomPreview(Geometry=food_waste_4, Material=colour_swatch_12)  # disabled
custom_preview_34 = CustomPreview(Geometry=cull_pattern_15, Material=colour_swatch_11)  # disabled
custom_preview_35 = CustomPreview(Geometry=paper_waste_4, Material=colour_swatch_14)  # disabled
custom_preview_36 = CustomPreview(Geometry=coffee_waste_4, Material=colour_swatch_15)  # disabled
custom_preview_37 = CustomPreview(Geometry=rainwater_4, Material=colour_swatch_17)  # disabled
custom_preview_38 = CustomPreview(Geometry=co2_4, Material=colour_swatch_16)  # disabled
custom_preview_39 = CustomPreview(Geometry=residual_heat_4, Material=colour_swatch_10)  # disabled
custom_preview_40 = CustomPreview(Geometry=cull_pattern_14, Material=colour_swatch_19)  # disabled
custom_preview_41 = CustomPreview(Geometry=cull_pattern_13, Material=colour_swatch_18)  # disabled

colour_swatch_20 = ColourSwatch(SwatchColor=RGB(249, 242, 142))
colour_swatch_21 = ColourSwatch(SwatchColor=RGB(160, 160, 167))
colour_swatch_22 = ColourSwatch(SwatchColor=RGB(111, 128, 188))
colour_swatch_23 = ColourSwatch(SwatchColor=RGB(139, 160, 92))
colour_swatch_24 = ColourSwatch(SwatchColor=RGB(244, 167, 146))
colour_swatch_25 = ColourSwatch(SwatchColor=RGB(200, 216, 132))
colour_swatch_26 = ColourSwatch(SwatchColor=RGB(238, 115, 143))
colour_swatch_27 = ColourSwatch(SwatchColor=RGB(166, 140, 193))

# ----
# Colors For Waste Types & UF Systems
# W1 Food Waste
# W2 Sawdust
# W3 Paper Waste
# W4 Coffee Waste
# W5 CO2
# W6 Rainwater
# W7 Residual Heat
# S2 Nutrient Dense Water
# S4 Fertiliser
# S5 Fish Food
# UF1 Vermicompost
# UF2 Aquaculture
# UF3 Mushroom Farm
# UF4 NFT
# UF5 Mediabeds
# UF6 Raised Bed
# UF7 Water Culture
# UF8 Plant Factory
# UF9 Aeroponics
colour_swatch_28 = ColourSwatch(SwatchColor=RGB(150, 183, 103))

# ----
# Stage 2 Decisions
panel_110 = Panel(merge_2)
list_item_17 = ListItem(List=panel_110, Index=0, Wrap=True)  # -> flatten(Item)
panel_111 = Panel(import_occupied_spaces_3.uf_system)

# ----
# Stage 5 Visualise Decisions
# Stage 1 Decisions
panel_112 = Panel(merge_2)
list_item_18 = ListItem(List=panel_112, Index=0, Wrap=True)  # -> flatten(Item)
panel_113 = Panel(import_occupied_spaces_4.uf_system)

# ----
# Stage 3 Decisions
panel_114 = Panel(merge_2)
list_item_19 = ListItem(List=panel_114, Index=0, Wrap=True)  # -> flatten(Item)
panel_115 = Panel(import_occupied_spaces.uf_system)

# ----
# Stage 4 Decisions
panel_116 = Panel(merge_2)
list_item_20 = ListItem(List=panel_116, Index=0, Wrap=True)  # -> flatten(Item)
panel_117 = Panel(import_occupied_spaces_2.uf_system)

# ----
# Import Assigned Urban Farming Systems
# Represent Systems With Colors
point_13 = Point(point_4)
panel_118 = Panel(import_occupied_spaces_3.vacant_space)

# ----
# Import Assigned Urban Farming Systems
# Represent Systems With Colors
point_14 = Point(point_4)
panel_119 = Panel(import_occupied_spaces_4.vacant_space)

# ----
# Import Assigned Urban Farming Systems
# Represent Systems With Colors
point_15 = Point(point_4)
panel_120 = Panel(import_occupied_spaces.vacant_space)

# ----
# Import Assigned Urban Farming Systems
# Represent Systems With Colors
point_16 = Point(point_4)
panel_121 = Panel(import_occupied_spaces_2.vacant_space)

find_similar_member_13 = FindSimilarMember(Data=panel_118, Set=list_item_17)  # -> Hit, Index

list_item_21 = ListItem(List=flatten(point_13), Index=find_similar_member_13.Index, Wrap=True)  # -> flatten(Item)
label_systems = TextTag(Location=list_item_21, Text=panel_118)

merge_12 = Merge(
    Data1=graft(import_occupied_spaces_3.vacant_space),
    Data2=graft(import_occupied_spaces_3.uf_system),
    Data3=graft(list_item_21))
panel_122 = Panel(merge_12)
list_item_22 = ListItem(List=merge_12, Index=1, Wrap=True)
list_item_23 = ListItem(List=merge_12, Index=2, Wrap=True)
point_17 = Point(list_item_23)
clean_tree_10 = CleanTree(RemoveNulls=True, RemoveInvalid=True, RemoveEmpty=False, Tree=list_item_22)
integer_in_uf_integer = GhPythonScript(x=clean_tree_10)  # -> out, a; inputs x: list
# ---------- integer_in_uf_integer: Python ----------
__author__ = "ereng"
__version__ = "2022.04.18"

import rhinoscriptsyntax as rs

for item in x:
    for index,char in enumerate(item):
        if index==2:
            a=char
# ---------- end integer_in_uf_integer ----------
panel_123 = Panel(integer_in_uf_integer.a)

# ----
# Match Identifier To Actual Surface
sort_list = SortList(Keys=area_3.Area, ValuesValuesA=vacant_space)  # -> reverse(Keys), ValuesValuesA
area_4 = Area(Geometry=sort_list.ValuesValuesA)  # -> Area, Centroid
surface_2 = Surface(sort_list.ValuesValuesA)
sort_list_2 = SortList(Keys=area_4.Area, ValuesValuesA=surface_2)  # -> reverse(graft(Keys)), reverse(ValuesValuesA)
surface_3 = Surface(graft(sort_list_2.ValuesValuesA))
list_item_24 = ListItem(List=flatten(surface_3), Index=find_similar_member_13.Index, Wrap=True)  # -> graft(Item)

move_to_plane = MoveToPlane(Geometry=list_item_24, Plane=point_17, Above=True, Below=True)  # -> Geometry, Transform
surface_4 = Surface(move_to_plane.Geometry)
equality_41 = Equality(FirstNumber=integer_in_uf_integer.a, SecondNumber=Slider(1, range=0..1))  # -> Equality, Inequality
equality_42 = Equality(FirstNumber=integer_in_uf_integer.a, SecondNumber=Slider(2, range=0..10))  # -> Equality, Inequality
equality_43 = Equality(FirstNumber=integer_in_uf_integer.a, SecondNumber=Slider(3, range=0..10))  # -> Equality, Inequality
equality_44 = Equality(FirstNumber=integer_in_uf_integer.a, SecondNumber=Slider(4, range=0..10))  # -> Equality, Inequality
equality_45 = Equality(FirstNumber=integer_in_uf_integer.a, SecondNumber=Slider(5, range=0..10))  # -> Equality, Inequality
equality_46 = Equality(FirstNumber=integer_in_uf_integer.a, SecondNumber=Slider(6, range=0..10))  # -> Equality, Inequality
equality_47 = Equality(FirstNumber=integer_in_uf_integer.a, SecondNumber=Slider(7, range=0..10))  # -> Equality, Inequality
equality_48 = Equality(FirstNumber=integer_in_uf_integer.a, SecondNumber=Slider(8, range=0..10))  # -> Equality, Inequality
equality_49 = Equality(FirstNumber=integer_in_uf_integer.a, SecondNumber=Slider(9, range=0..10))  # -> Equality, Inequality
vermicompost = CullPattern(List=surface_4, CullPattern=equality_41.Equality)
aquaculture = CullPattern(List=surface_4, CullPattern=equality_42.Equality)
mushroom = CullPattern(List=surface_4, CullPattern=equality_43.Equality)
nft = CullPattern(List=surface_4, CullPattern=equality_44.Equality)
mediabed = CullPattern(List=surface_4, CullPattern=equality_45.Equality)
raised_bed = CullPattern(List=surface_4, CullPattern=equality_46.Equality)
water_culture = CullPattern(List=surface_4, CullPattern=equality_47.Equality)
plant_factory = CullPattern(List=surface_4, CullPattern=equality_48.Equality)
aeroponics = CullPattern(List=surface_4, CullPattern=equality_49.Equality)
custom_preview_42 = CustomPreview(Geometry=mushroom, Material=colour_swatch_27)  # disabled
custom_preview_43 = CustomPreview(Geometry=nft, Material=colour_swatch_28)  # disabled
custom_preview_44 = CustomPreview(Geometry=mediabed, Material=colour_swatch_23)  # disabled
custom_preview_45 = CustomPreview(Geometry=raised_bed, Material=colour_swatch_24)  # disabled
custom_preview_46 = CustomPreview(Geometry=water_culture, Material=colour_swatch_25)  # disabled
custom_preview_47 = CustomPreview(Geometry=plant_factory, Material=colour_swatch_26)  # disabled
custom_preview_48 = CustomPreview(Geometry=aeroponics, Material=colour_swatch_20)  # disabled
custom_preview_49 = CustomPreview(Geometry=vermicompost, Material=colour_swatch_21)  # disabled
custom_preview_50 = CustomPreview(Geometry=aquaculture, Material=colour_swatch_22)  # disabled

area_5 = Area(Geometry=surface_4)  # -> Area, Centroid
move_10 = Move(Geometry=area_5.Centroid, Motion=Vector(-1.142851637, -11.1637109, 0))  # -> Geometry, Transform
text_tag_2 = TextTag(Location=move_10.Geometry, Text=list_item_22, Colour=RGB(0, 0, 0))

find_similar_member_14 = FindSimilarMember(Data=panel_119, Set=list_item_18)  # -> Hit, Index

list_item_25 = ListItem(List=flatten(point_14), Index=find_similar_member_14.Index, Wrap=True)  # -> flatten(Item)
label_systems_2 = TextTag(Location=list_item_25, Text=panel_119)

merge_13 = Merge(
    Data1=graft(import_occupied_spaces_4.vacant_space),
    Data2=graft(import_occupied_spaces_4.uf_system),
    Data3=graft(list_item_25))
panel_124 = Panel(merge_13)
list_item_26 = ListItem(List=merge_13, Index=1, Wrap=True)
list_item_27 = ListItem(List=merge_13, Index=2, Wrap=True)
point_18 = Point(list_item_27)
clean_tree_11 = CleanTree(RemoveNulls=True, RemoveInvalid=True, RemoveEmpty=False, Tree=list_item_26)
integer_in_uf_integer_2 = GhPythonScript(x=clean_tree_11)  # -> out, a; inputs x: list; same code as integer_in_uf_integer
panel_125 = Panel(integer_in_uf_integer_2.a)

# ----
# Match Identifier To Actual Surface
sort_list_3 = SortList(Keys=area_3.Area, ValuesValuesA=vacant_space)  # -> reverse(Keys), ValuesValuesA
area_6 = Area(Geometry=sort_list_3.ValuesValuesA)  # -> Area, Centroid
surface_5 = Surface(sort_list_3.ValuesValuesA)
sort_list_4 = SortList(Keys=area_6.Area, ValuesValuesA=surface_5)  # -> reverse(graft(Keys)), reverse(ValuesValuesA)
surface_6 = Surface(graft(sort_list_4.ValuesValuesA))
list_item_28 = ListItem(List=flatten(surface_6), Index=find_similar_member_14.Index, Wrap=True)  # -> graft(Item)

move_to_plane_2 = MoveToPlane(Geometry=list_item_28, Plane=point_18, Above=True, Below=True)  # -> Geometry, Transform
surface_7 = Surface(move_to_plane_2.Geometry)
equality_50 = Equality(FirstNumber=integer_in_uf_integer_2.a, SecondNumber=Slider(1, range=0..1))  # -> Equality, Inequality
equality_51 = Equality(FirstNumber=integer_in_uf_integer_2.a, SecondNumber=Slider(2, range=0..10))  # -> Equality, Inequality
equality_52 = Equality(FirstNumber=integer_in_uf_integer_2.a, SecondNumber=Slider(3, range=0..10))  # -> Equality, Inequality
equality_53 = Equality(FirstNumber=integer_in_uf_integer_2.a, SecondNumber=Slider(4, range=0..10))  # -> Equality, Inequality
equality_54 = Equality(FirstNumber=integer_in_uf_integer_2.a, SecondNumber=Slider(5, range=0..10))  # -> Equality, Inequality
equality_55 = Equality(FirstNumber=integer_in_uf_integer_2.a, SecondNumber=Slider(6, range=0..10))  # -> Equality, Inequality
equality_56 = Equality(FirstNumber=integer_in_uf_integer_2.a, SecondNumber=Slider(7, range=0..10))  # -> Equality, Inequality
equality_57 = Equality(FirstNumber=integer_in_uf_integer_2.a, SecondNumber=Slider(8, range=0..10))  # -> Equality, Inequality
equality_58 = Equality(FirstNumber=integer_in_uf_integer_2.a, SecondNumber=Slider(9, range=0..10))  # -> Equality, Inequality
vermicompost_2 = CullPattern(List=surface_7, CullPattern=equality_50.Equality)
aquaculture_2 = CullPattern(List=surface_7, CullPattern=equality_51.Equality)
mushroom_2 = CullPattern(List=surface_7, CullPattern=equality_52.Equality)
nft_2 = CullPattern(List=surface_7, CullPattern=equality_53.Equality)
mediabed_2 = CullPattern(List=surface_7, CullPattern=equality_54.Equality)
raised_bed_2 = CullPattern(List=surface_7, CullPattern=equality_55.Equality)
water_culture_2 = CullPattern(List=surface_7, CullPattern=equality_56.Equality)
plant_factory_2 = CullPattern(List=surface_7, CullPattern=equality_57.Equality)
aeroponics_2 = CullPattern(List=surface_7, CullPattern=equality_58.Equality)
custom_preview_51 = CustomPreview(Geometry=mushroom_2, Material=colour_swatch_27)  # disabled
custom_preview_52 = CustomPreview(Geometry=nft_2, Material=colour_swatch_28)  # disabled
custom_preview_53 = CustomPreview(Geometry=mediabed_2, Material=colour_swatch_23)  # disabled
custom_preview_54 = CustomPreview(Geometry=raised_bed_2, Material=colour_swatch_24)  # disabled
custom_preview_55 = CustomPreview(Geometry=water_culture_2, Material=colour_swatch_25)  # disabled
custom_preview_56 = CustomPreview(Geometry=plant_factory_2, Material=colour_swatch_26)  # disabled
custom_preview_57 = CustomPreview(Geometry=aeroponics_2, Material=colour_swatch_20)  # disabled
custom_preview_58 = CustomPreview(Geometry=vermicompost_2, Material=colour_swatch_21)  # disabled
custom_preview_59 = CustomPreview(Geometry=aquaculture_2, Material=colour_swatch_22)  # disabled

area_7 = Area(Geometry=surface_7)  # -> Area, Centroid
move_11 = Move(Geometry=area_7.Centroid, Motion=Vector(-1.142851637, -11.1637109, 0))  # -> Geometry, Transform
text_tag_3 = TextTag(Location=move_11.Geometry, Text=list_item_26, Colour=RGB(0, 0, 0))

surface_8 = Surface([vermicompost_2, aquaculture_2, mushroom_2, nft_2, mediabed_2, water_culture_2, plant_factory_2])
surface_9 = Surface(raised_bed_2)
unit_z_6 = UnitZ(Factor=3)
extrude = Extrude(Base=surface_8, Direction=unit_z_6)
custom_preview_60 = CustomPreview(Geometry=[extrude, surface_9], Material=ColourSwatch(SwatchColor=RGB(150, 183, 103)))

find_similar_member_15 = FindSimilarMember(Data=panel_120, Set=list_item_19)  # -> Hit, Index

list_item_29 = ListItem(List=flatten(point_15), Index=find_similar_member_15.Index, Wrap=True)  # -> flatten(Item)
label_systems_3 = TextTag(Location=list_item_29, Text=panel_120)

merge_14 = Merge(
    Data1=graft(import_occupied_spaces.vacant_space),
    Data2=graft(import_occupied_spaces.uf_system),
    Data3=graft(list_item_29))
panel_126 = Panel(merge_14)
list_item_30 = ListItem(List=merge_14, Index=1, Wrap=True)
list_item_31 = ListItem(List=merge_14, Index=2, Wrap=True)
point_19 = Point(list_item_31)
clean_tree_12 = CleanTree(RemoveNulls=True, RemoveInvalid=True, RemoveEmpty=False, Tree=list_item_30)
integer_in_uf_integer_3 = GhPythonScript(x=clean_tree_12)  # -> out, a; inputs x: list; same code as integer_in_uf_integer
panel_127 = Panel(integer_in_uf_integer_3.a)

# ----
# Match Identifier To Actual Surface
sort_list_5 = SortList(Keys=area_3.Area, ValuesValuesA=vacant_space)  # -> reverse(Keys), ValuesValuesA
area_8 = Area(Geometry=sort_list_5.ValuesValuesA)  # -> Area, Centroid
surface_10 = Surface(sort_list_5.ValuesValuesA)
sort_list_6 = SortList(Keys=area_8.Area, ValuesValuesA=surface_10)  # -> reverse(graft(Keys)), reverse(ValuesValuesA)
surface_11 = Surface(graft(sort_list_6.ValuesValuesA))
list_item_32 = ListItem(List=flatten(surface_11), Index=find_similar_member_15.Index, Wrap=True)  # -> graft(Item)

move_to_plane_3 = MoveToPlane(Geometry=list_item_32, Plane=point_19, Above=True, Below=True)  # -> Geometry, Transform
surface_12 = Surface(move_to_plane_3.Geometry)
equality_59 = Equality(FirstNumber=integer_in_uf_integer_3.a, SecondNumber=Slider(1, range=0..1))  # -> Equality, Inequality
equality_60 = Equality(FirstNumber=integer_in_uf_integer_3.a, SecondNumber=Slider(2, range=0..10))  # -> Equality, Inequality
equality_61 = Equality(FirstNumber=integer_in_uf_integer_3.a, SecondNumber=Slider(3, range=0..10))  # -> Equality, Inequality
equality_62 = Equality(FirstNumber=integer_in_uf_integer_3.a, SecondNumber=Slider(4, range=0..10))  # -> Equality, Inequality
equality_63 = Equality(FirstNumber=integer_in_uf_integer_3.a, SecondNumber=Slider(5, range=0..10))  # -> Equality, Inequality
equality_64 = Equality(FirstNumber=integer_in_uf_integer_3.a, SecondNumber=Slider(6, range=0..10))  # -> Equality, Inequality
equality_65 = Equality(FirstNumber=integer_in_uf_integer_3.a, SecondNumber=Slider(7, range=0..10))  # -> Equality, Inequality
equality_66 = Equality(FirstNumber=integer_in_uf_integer_3.a, SecondNumber=Slider(8, range=0..10))  # -> Equality, Inequality
equality_67 = Equality(FirstNumber=integer_in_uf_integer_3.a, SecondNumber=Slider(9, range=0..10))  # -> Equality, Inequality
vermicompost_3 = CullPattern(List=surface_12, CullPattern=equality_59.Equality)
aquaculture_3 = CullPattern(List=surface_12, CullPattern=equality_60.Equality)
mushroom_3 = CullPattern(List=surface_12, CullPattern=equality_61.Equality)
nft_3 = CullPattern(List=surface_12, CullPattern=equality_62.Equality)
mediabed_3 = CullPattern(List=surface_12, CullPattern=equality_63.Equality)
raised_bed_3 = CullPattern(List=surface_12, CullPattern=equality_64.Equality)
water_culture_3 = CullPattern(List=surface_12, CullPattern=equality_65.Equality)
plant_factory_3 = CullPattern(List=surface_12, CullPattern=equality_66.Equality)
aeroponics_3 = CullPattern(List=surface_12, CullPattern=equality_67.Equality)
custom_preview_61 = CustomPreview(Geometry=mushroom_3, Material=colour_swatch_27)  # disabled
custom_preview_62 = CustomPreview(Geometry=nft_3, Material=colour_swatch_28)  # disabled
custom_preview_63 = CustomPreview(Geometry=mediabed_3, Material=colour_swatch_23)  # disabled
custom_preview_64 = CustomPreview(Geometry=raised_bed_3, Material=colour_swatch_24)  # disabled
custom_preview_65 = CustomPreview(Geometry=water_culture_3, Material=colour_swatch_25)  # disabled
custom_preview_66 = CustomPreview(Geometry=plant_factory_3, Material=colour_swatch_26)  # disabled
custom_preview_67 = CustomPreview(Geometry=aeroponics_3, Material=colour_swatch_20)  # disabled
custom_preview_68 = CustomPreview(Geometry=vermicompost_3, Material=colour_swatch_21)  # disabled
custom_preview_69 = CustomPreview(Geometry=aquaculture_3, Material=colour_swatch_22)  # disabled

area_9 = Area(Geometry=surface_12)  # -> Area, Centroid
move_12 = Move(Geometry=area_9.Centroid, Motion=Vector(-1.142851637, -11.1637109, 0))  # -> Geometry, Transform
text_tag_4 = TextTag(Location=move_12.Geometry, Text=list_item_30, Colour=RGB(0, 0, 0))

find_similar_member_16 = FindSimilarMember(Data=panel_121, Set=list_item_20)  # -> Hit, Index

list_item_33 = ListItem(List=flatten(point_16), Index=find_similar_member_16.Index, Wrap=True)  # -> flatten(Item)
label_systems_4 = TextTag(Location=list_item_33, Text=panel_121)

merge_15 = Merge(
    Data1=graft(import_occupied_spaces_2.vacant_space),
    Data2=graft(import_occupied_spaces_2.uf_system),
    Data3=graft(list_item_33))
panel_128 = Panel(merge_15)
list_item_34 = ListItem(List=merge_15, Index=1, Wrap=True)
list_item_35 = ListItem(List=merge_15, Index=2, Wrap=True)
point_20 = Point(list_item_35)
clean_tree_13 = CleanTree(RemoveNulls=True, RemoveInvalid=True, RemoveEmpty=False, Tree=list_item_34)
integer_in_uf_integer_4 = GhPythonScript(x=clean_tree_13)  # -> out, a; inputs x: list; same code as integer_in_uf_integer
panel_129 = Panel(integer_in_uf_integer_4.a)

# ----
# Match Identifier To Actual Surface
sort_list_7 = SortList(Keys=area_3.Area, ValuesValuesA=vacant_space)  # -> reverse(Keys), ValuesValuesA
area_10 = Area(Geometry=sort_list_7.ValuesValuesA)  # -> Area, Centroid
surface_13 = Surface(sort_list_7.ValuesValuesA)
sort_list_8 = SortList(Keys=area_10.Area, ValuesValuesA=surface_13)  # -> reverse(graft(Keys)), reverse(ValuesValuesA)
surface_14 = Surface(graft(sort_list_8.ValuesValuesA))
list_item_36 = ListItem(List=flatten(surface_14), Index=find_similar_member_16.Index, Wrap=True)  # -> graft(Item)

move_to_plane_4 = MoveToPlane(Geometry=list_item_36, Plane=point_20, Above=True, Below=True)  # -> Geometry, Transform
surface_15 = Surface(move_to_plane_4.Geometry)
equality_68 = Equality(FirstNumber=integer_in_uf_integer_4.a, SecondNumber=Slider(1, range=0..1))  # -> Equality, Inequality
equality_69 = Equality(FirstNumber=integer_in_uf_integer_4.a, SecondNumber=Slider(2, range=0..10))  # -> Equality, Inequality
equality_70 = Equality(FirstNumber=integer_in_uf_integer_4.a, SecondNumber=Slider(3, range=0..10))  # -> Equality, Inequality
equality_71 = Equality(FirstNumber=integer_in_uf_integer_4.a, SecondNumber=Slider(4, range=0..10))  # -> Equality, Inequality
equality_72 = Equality(FirstNumber=integer_in_uf_integer_4.a, SecondNumber=Slider(5, range=0..10))  # -> Equality, Inequality
equality_73 = Equality(FirstNumber=integer_in_uf_integer_4.a, SecondNumber=Slider(6, range=0..10))  # -> Equality, Inequality
equality_74 = Equality(FirstNumber=integer_in_uf_integer_4.a, SecondNumber=Slider(7, range=0..10))  # -> Equality, Inequality
equality_75 = Equality(FirstNumber=integer_in_uf_integer_4.a, SecondNumber=Slider(8, range=0..10))  # -> Equality, Inequality
equality_76 = Equality(FirstNumber=integer_in_uf_integer_4.a, SecondNumber=Slider(9, range=0..10))  # -> Equality, Inequality
vermicompost_4 = CullPattern(List=surface_15, CullPattern=equality_68.Equality)
aquaculture_4 = CullPattern(List=surface_15, CullPattern=equality_69.Equality)
mushroom_4 = CullPattern(List=surface_15, CullPattern=equality_70.Equality)
nft_4 = CullPattern(List=surface_15, CullPattern=equality_71.Equality)
mediabed_4 = CullPattern(List=surface_15, CullPattern=equality_72.Equality)
raised_bed_4 = CullPattern(List=surface_15, CullPattern=equality_73.Equality)
water_culture_4 = CullPattern(List=surface_15, CullPattern=equality_74.Equality)
plant_factory_4 = CullPattern(List=surface_15, CullPattern=equality_75.Equality)
aeroponics_4 = CullPattern(List=surface_15, CullPattern=equality_76.Equality)
custom_preview_70 = CustomPreview(Geometry=mushroom_4, Material=colour_swatch_27)  # disabled
custom_preview_71 = CustomPreview(Geometry=nft_4, Material=colour_swatch_28)  # disabled
custom_preview_72 = CustomPreview(Geometry=mediabed_4, Material=colour_swatch_23)  # disabled
custom_preview_73 = CustomPreview(Geometry=raised_bed_4, Material=colour_swatch_24)  # disabled
custom_preview_74 = CustomPreview(Geometry=water_culture_4, Material=colour_swatch_25)  # disabled
custom_preview_75 = CustomPreview(Geometry=plant_factory_4, Material=colour_swatch_26)  # disabled
custom_preview_76 = CustomPreview(Geometry=aeroponics_4, Material=colour_swatch_20)  # disabled
custom_preview_77 = CustomPreview(Geometry=vermicompost_4, Material=colour_swatch_21)  # disabled
custom_preview_78 = CustomPreview(Geometry=aquaculture_4, Material=colour_swatch_22)  # disabled

area_11 = Area(Geometry=surface_15)  # -> Area, Centroid
move_13 = Move(Geometry=area_11.Centroid, Motion=Vector(-1.142851637, -11.1637109, 0))  # -> Geometry, Transform
text_tag_5 = TextTag(Location=move_13.Geometry, Text=list_item_34, Colour=RGB(0, 0, 0))
